# Grasshopper definition test.gh (Grasshopper 1.0.8)
# plug-ins: RhinoCodePluginGH, LunchBox

ファイル選択 = Button()
data_recorder = DataRecorder(ファイル選択, DataLimit=-10, RecordData=True)
list_item = ListItem(List=data_recorder, Index="-2", Wrap=True)
python_3_script = Python3Script(activate=list_item)  # -> out, id_name, kanamono_type, position, rotation; inputs activate: Boolean
# ---------- python_3_script: Python ----------
import json
import tkinter as tk
from tkinter import filedialog
import os
from Grasshopper import DataTree
from Grasshopper.Kernel.Data import GH_Path

def select_json_file():
    # Hide the root window
    root = tk.Tk()
    root.withdraw()

    # Open file dialog to select a JSON file
    file_path = filedialog.askopenfilename(
        title="Select a JSON file",
        filetypes=[("JSON files", "*.json")]
    )

    # Return the file path
    return file_path

def list_to_datatree(input_list):
    tree = DataTree[object]()
    
    for i, item in enumerate(input_list):
        path = GH_Path(i)  # 各リストに対してパスを作成
        if isinstance(item, list):  # ネストされたリストにも対応
            for j, sub_item in enumerate(item):
                tree.Add(sub_item, path)
        else:
            tree.Add(item, path)
    
    return tree

if activate:
    # If button is pressed, open the file dialog
    file_path = select_json_file()

    if file_path and os.path.exists(file_path):
        with open(file_path, 'r') as file:
            json_data_list = json.load(file)
        # Extract fields from the JSON data
        id_name = [None] * len(json_data_list)
        kanamono_type = [None] * len(json_data_list)
        position = [None] * len(json_data_list)
        rotation = [None] * len(json_data_list)
        for i, json_data in enumerate(json_data_list):
            id_name[i] = json_data.get("id","No 'id' key")
            kanamono_type[i] = json_data.get("kanamono_type", "No 'kanamono_type' key")
            position[i] = json_data.get("position", "No 'position' key")
            rotation[i] = json_data.get("rotation", "No 'rotation' key")

        id_name = list_to_datatree(id_name)
        kanamono_type = list_to_datatree(kanamono_type)
        position = list_to_datatree(position)
        rotation = list_to_datatree(rotation)
    else:
        output = "No valid file selected."
else:
    output = "Waiting for activation..."
# ---------- end python_3_script ----------
panel = Panel(python_3_script.position)
python_3_script_2 = Python3Script(rotation=python_3_script.rotation, position=python_3_script.position)  # -> out, transform; inputs rotation: list of Double, position: list of Double
# ---------- python_3_script_2: Python ----------
# requirements: trimesh
import Rhino.Geometry as rg
import math
import numpy as np
import trimesh

def quaternion_to_matrix(q, t):
    q = np.asanyarray(q,dtype=np.float64)
    rotation_matrix = trimesh.transformations.quaternion_matrix(q)
    translation_matrix = trimesh.transformations.translation_matrix(t)
    
    transformation_matrix = translation_matrix @ rotation_matrix


    return transformation_matrix

def transform_from_matrix(transformation_matrix):

    switch_matrix = np.array([
        [1.0,0.0,0.0,0.0],
        [0.0,1.0,0.0,0.0],
        [0.0,0.0,1.0,0.0],
        [0.0,0.0,0.0,1.0]
    ])

    switch_back_matrix = np.linalg.inv(switch_matrix)

    transformation_matrix = transformation_matrix @ switch_matrix 
    # 4x4の変換行列を初期化
    transform = rg.Transform.Identity

    # クォータニオンから回転行列の成分を設定
    transform.M00 = transformation_matrix[0,0]
    transform.M01 = transformation_matrix[0,1]
    transform.M02 = transformation_matrix[0,2]
    transform.M03 = transformation_matrix[0,3]

    transform.M10 = transformation_matrix[1,0]
    transform.M11 = transformation_matrix[1,1]
    transform.M12 = transformation_matrix[1,2]
    transform.M13 = transformation_matrix[1,3]

    transform.M20 = transformation_matrix[2,0]
    transform.M21 = transformation_matrix[2,1]
    transform.M22 = transformation_matrix[2,2]
    transform.M23 = transformation_matrix[2,3]

    # M30, M31, M32, M33 はホモジニアス座標なので、そのままにする
    transform.M30 = transformation_matrix[3,0]
    transform.M31 = transformation_matrix[3,1]
    transform.M32 = transformation_matrix[3,2]
    transform.M33 = transformation_matrix[3,3]

    return transform

transform_matrix = quaternion_to_matrix(rotation,position)
transform = transform_from_matrix(transform_matrix)
# ---------- end python_3_script_2 ----------
layer_reference = LayerReference(ReferenceToggle=Toggle(True), LayerName=python_3_script.kanamono_type)  # -> Geometry, Name, Color, UserStringKeys, UserStringValues, GUID
transform = Transform(Geometry=layer_reference.Geometry, Transform=python_3_script_2.transform)
